# Grasshopper definition process_buildings.gh (Grasshopper 1.0.7)
# plug-ins: Geospatial, Ostate Plugin

# ----
# Canvas colours
boolean_toggle = BooleanToggle(False)
canvas_colours = PythonScript(
    Monochrome=boolean_toggle,
    CanvasColour=ColourSwatch(SwatchColor=RGB(255, 255, 255)),
    CanvasEdge=ColourSwatch(SwatchColor=RGB(0, 0, 0)),
    Shade=ColourSwatch(SwatchColor=RGBA(255, 255, 255, 0)),
    Grid=ColourSwatch(SwatchColor=RGBA(0, 0, 0, 0)))  # inputs Monochrome: Boolean, CanvasColour: Color, CanvasEdge: Color
# ---------- canvas_colours: Python ----------
import Grasshopper as gh

# Set background colour
gh.GUI.Canvas.GH_Skin.canvas_mono = Monochrome
if Monochrome:
    gh.GUI.Canvas.GH_Skin.canvas_mono_color = CanvasColour
else:
    gh.GUI.Canvas.GH_Skin.canvas_back = CanvasColour

# Other effects
gh.GUI.Canvas.GH_Skin.canvas_shade = Shade
gh.GUI.Canvas.GH_Skin.canvas_edge = CanvasEdge
gh.GUI.Canvas.GH_Skin.canvas_grid = Grid
# ---------- end canvas_colours ----------

file_path_to_geojson = FilePath("D:\DELFT\Q3 GEO1004 3D-Model\assignment3\_data\built_ht.geojson")
read_geojson = ReadGeoJSON(File=file_path_to_geojson)  # -> Type, Geometry, Keys, Values
boundary_surfaces = BoundarySurfaces(Edges=read_geojson.Geometry)
key_value_search = KeyValueSearch(Keys=read_geojson.Keys, Values=read_geojson.Values, Search="z_med_bott")
key_value_search_2 = KeyValueSearch(Keys=read_geojson.Keys, Values=read_geojson.Values, Search="identifica")
key_value_search_3 = KeyValueSearch(Keys=read_geojson.Keys, Values=read_geojson.Values, Search="diff_top_b")
key_value_search_4 = KeyValueSearch(Keys=read_geojson.Keys, Values=read_geojson.Values, Search="bouwjaar")

footprints = Data(flatten(boundary_surfaces))
year = Data(flatten(key_value_search_4))
base_z = Data(flatten(key_value_search))
height = Data(flatten(key_value_search_3))
id = Data(flatten(key_value_search_2))
ghpython_script = GhPythonScript(polygons=footprints, base_heights=base_z, heights=height, years=year, ids=id)  # -> out, path, base_meshes, roof_meshes, wall_meshes; inputs polygons: list of Brep, base_heights: list, heights: list, years: list, ids: list
# ---------- ghpython_script: Python ----------
import Rhino.Geometry as rg
import os
import json
from json import encoder
encoder.FLOAT_REPR = lambda x: format(x, '.2f') # globally format json floats

ghpath = ghenv.LocalScope.ghdoc.Path
ghdir = os.path.dirname(ghpath)
path = ghdir + "/../_data/export/buildings_export.json"

j = {
"type": "CityJSON",
"version": "1.0",
"metadata": {"referenceSystem": "urn:ogc:def:crs:EPSG::7415"},
"CityObjects": {},
"vertices": []
}

base_meshes = []
roof_meshes = []
wall_meshes = []

vertex_count = 0
mesh_settings = rg.MeshingParameters.Coarse

def mesh_to_obj(mesh, index_offset):
    surface = [[[ v+index_offset for v in list(f)[0:3]]] if f.IsTriangle
               else [[ v+index_offset for v in list(f)]] for f in mesh.Faces]
    verts = [[float(v.X), float(v.Y), float(v.Z)] for v in mesh.Vertices]
    return surface, verts


for polygon, base_height, height, year, id in zip(
polygons, base_heights, heights, years, ids):
    
    # flip base surface if normal goes up
    if polygon.Surfaces[0].NormalAt(0,0).Z > 0:
        polygon.Flip()
    
    # move to base height
    trans = rg.Transform.Translation(0, 0, base_height)
    polygon.Transform(trans)
    
    # base mesh
    base_mesh = rg.Mesh.CreateFromBrep(polygon, mesh_settings)[0]
    base_meshes.append(base_mesh)
    
    # roof mesh
    roof_mesh = base_mesh.Duplicate()
    roof_mesh.Flip(True, True, True)
    trans = rg.Transform.Translation(0, 0, height)
    roof_mesh.Transform(trans)
    roof_meshes.append(roof_mesh)
    
    # wall mesh
    wall_mesh = rg.Mesh()
    for i, ring in enumerate(polygon.Loops):
        curve = ring.To3dCurve()
        ring_mesh = rg.Mesh()
        
        # check outter ring orientation
        if i == 0:
            if curve.ClosedCurveOrientation() == rg.CurveOrientation.Clockwise:
                curve.Reverse()
        # check inner ring orientation
        else:
            if not curve.ClosedCurveOrientation() == rg.CurveOrientation.Clockwise:
                curve.Reverse()
        
        points = curve.ToPolyline(0,0,0,0).ToPolyline()
        for i, pt in enumerate(points):
            ring_mesh.Vertices.Add(pt.X, pt.Y, pt.Z)
            ring_mesh.Vertices.Add(pt.X, pt.Y, pt.Z + height)
            
            # quad face
            ring_mesh.Faces.AddFace(
                0 + i*2,
                2 + i*2,
                3 + i*2,
                1 + i*2,
            )
        
        ring_mesh.Normals.ComputeNormals()
        ring_mesh.Compact()
        wall_mesh.Append(ring_mesh)
    wall_meshes.append(wall_mesh)
    
    # Get lists of triangles and verts
    base_surface, base_verts = mesh_to_obj(base_mesh, vertex_count)
    vertex_count += len(base_verts)
    roof_surface, roof_verts = mesh_to_obj(roof_mesh, vertex_count)
    vertex_count += len(roof_verts)
    wall_surface, wall_verts = mesh_to_obj(wall_mesh, vertex_count)
    vertex_count += len(wall_verts)
    
    # flatten into one surface
    surface = []
    surface.extend(base_surface)
    surface.extend(roof_surface)
    surface.extend(wall_surface)
    
    # flatten into list of semantic values
    values = []
    values.extend([0]*len(base_surface))
    values.extend([1]*len(roof_surface))
    values.extend([2]*len(wall_surface))
    
    cityobj = {
        "type": "Building",
        "attributes": {
            "yearOfConstruction": year,
            "measuredHeight": height,
            "storeysAboveGround": int(height/3.0)
        },
        "geometry": [
            {
                "type": "Solid",
                "lod": 1.2,
                "boundaries" : [surface],
                "values": [values],
                "semantics": {
                    "surfaces": [
                        {"type": "GroundSurface"},
                        {"type": "RoofSurface"},
                        {"type": "WallSurface"}
                    ],
                },
            }
        ]
    }
    
    j["CityObjects"][id] = cityobj
    j["vertices"].extend(base_verts)
    j["vertices"].extend(roof_verts)
    j["vertices"].extend(wall_verts)

with open(path, 'w') as outfile:
    json.dump(j, outfile)
# ---------- end ghpython_script ----------
panel = Panel(ghpython_script.path)
