# Grasshopper definition test_geojson_footprints.gh (Grasshopper 1.0.7)
# plug-ins: Geospatial

# ----
# Canvas colours
boolean_toggle = BooleanToggle(False)
canvas_colours = PythonScript(
    Monochrome=boolean_toggle,
    CanvasColour=ColourSwatch(SwatchColor=RGB(255, 255, 255)),
    CanvasEdge=ColourSwatch(SwatchColor=RGB(0, 0, 0)),
    Shade=ColourSwatch(SwatchColor=RGBA(255, 255, 255, 0)),
    Grid=ColourSwatch(SwatchColor=RGBA(0, 0, 0, 0)))  # inputs Monochrome: Boolean, CanvasColour: Color, CanvasEdge: Color
# ---------- canvas_colours: Python ----------
import Grasshopper as gh

# Set background colour
gh.GUI.Canvas.GH_Skin.canvas_mono = Monochrome
if Monochrome:
    gh.GUI.Canvas.GH_Skin.canvas_mono_color = CanvasColour
else:
    gh.GUI.Canvas.GH_Skin.canvas_back = CanvasColour

# Other effects
gh.GUI.Canvas.GH_Skin.canvas_shade = Shade
gh.GUI.Canvas.GH_Skin.canvas_edge = CanvasEdge
gh.GUI.Canvas.GH_Skin.canvas_grid = Grid
# ---------- end canvas_colours ----------

file_path = FilePath("D:\DELFT\Q3 GEO1004 3D-Model\assignment3\_data\probem_building.geojson")
file_path_2 = FilePath("D:\DELFT\Q3 GEO1004 3D-Model\assignment3\_data\probem_building.geojson")

# ---- group: correct
ghpython_script = GhPythonScript(path=file_path)  # -> out, path; disabled
# ---------- ghpython_script: Python ----------
import Rhino.Geometry as rg
import json

j = {}

with open(path, 'r') as f:
    j = json.load(f)

for i, feature in enumerate(j['features']):
    geometry = feature['geometry']
    if geometry['type'] == "MultiPolygon":
        
        for p, polygon in enumerate(geometry['coordinates']):
            outter = polygon[0]
            holes = polygon[1:len(polygon)]
            
            points = []
            for coord in outter:
                points.append(rg.Point3d( coord[0], coord[1], 0 ))
            curve = rg.Polyline(points).ToNurbsCurve()
            
            if curve.ClosedCurveOrientation() == rg.CurveOrientation.Clockwise:
                print "Oh damn! #%s boundary is clockwise." % feature['properties']['identifica']
                j['features'][i]['geometry']['coordinates'][p][0] = list(reversed(outter))
            
            for h, inner in enumerate(holes):
                inner_points = []
                for coord in inner:
                    inner_points.append(rg.Point3d( coord[0], coord[1], 0 ))
                curve = rg.Polyline(inner_points).ToNurbsCurve()
                
                if curve.ClosedCurveOrientation() == rg.CurveOrientation.CounterClockwise:
                    print "Oh damn! #%s inner ring #%d is counter-clockwise." % (feature['properties']['identifica'], i)
                    j['features'][i]['geometry']['coordinates'][p][1+h] = list(reversed(inner))

path = path.replace('.','_fixed.')
with open(path, 'w') as f:
    json.dump(j, f)
# ---------- end ghpython_script ----------

# ---- group: inverted
ghpython_script_2 = GhPythonScript(path=file_path)  # -> out, path; disabled
# ---------- ghpython_script_2: Python ----------
import Rhino.Geometry as rg
import json

j = {}

with open(path, 'r') as f:
    j = json.load(f)

for i, feature in enumerate(j['features']):
    geometry = feature['geometry']
    if geometry['type'] == "MultiPolygon":
        
        for p, polygon in enumerate(geometry['coordinates']):
            outter = polygon[0]
            holes = polygon[1:len(polygon)]
            
            points = []
            for coord in outter:
                points.append(rg.Point3d( coord[0], coord[1], 0 ))
            curve = rg.Polyline(points).ToNurbsCurve()
            
            if curve.ClosedCurveOrientation() == rg.CurveOrientation.CounterClockwise:
                print "Oh damn! #%s boundary is counter-clockwise." % feature['properties']['identifica']
                j['features'][i]['geometry']['coordinates'][p][0] = list(reversed(outter))
            
            for h, inner in enumerate(holes):
                inner_points = []
                for coord in inner:
                    inner_points.append(rg.Point3d( coord[0], coord[1], 0 ))
                curve = rg.Polyline(inner_points).ToNurbsCurve()
                
                if curve.ClosedCurveOrientation() == rg.CurveOrientation.Clockwise:
                    print "Oh damn! #%s inner ring #%d is clockwise." % (feature['properties']['identifica'], h)
                    j['features'][i]['geometry']['coordinates'][p][1+h] = list(reversed(inner))

path = path.replace('.','_fixed_inverted.')
with open(path, 'w') as f:
    json.dump(j, f)
# ---------- end ghpython_script_2 ----------

# ----
read_geojson = ReadGeoJSON(File=file_path_2)  # -> Type, Geometry, Keys, Values
reduce = Reduce(Polyline=read_geojson.Geometry, Tolerance=Slider(2, range=0..10))  # -> Polyline, Reduction
feature_from_polygons = FeatureFromPolygons(Polygons=reduce.Polyline, Keys=read_geojson.Keys, Values=read_geojson.Values)
file_path_3 = FilePath("D:\DELFT\Q3 GEO1004 3D-Model\assignment3\_data\")
write_file = WriteFile(Directory=file_path_3, Filename="problem_building_simpler.geojson", Data=feature_from_polygons, Run=Button())
