# Grasshopper definition process_TIN.gh (Grasshopper 1.0.7)
# plug-ins: MeshEdit Components

# ----
# Canvas colours
boolean_toggle = BooleanToggle(False)
canvas_colours = PythonScript(
    Borderless=boolean_toggle,
    CanvasColour=ColourSwatch(SwatchColor=RGB(255, 255, 255)),
    CanvasEdge=ColourSwatch(SwatchColor=RGB(0, 0, 0)),
    Shade=ColourSwatch(SwatchColor=RGBA(255, 255, 255, 0)),
    Grid=ColourSwatch(SwatchColor=RGBA(0, 0, 0, 0)))  # inputs Borderless: Boolean, CanvasColour: Color, CanvasEdge: Color
# ---------- canvas_colours: Python ----------
import Grasshopper as gh

# Set background colour
gh.GUI.Canvas.GH_Skin.canvas_mono = Borderless
if Borderless:
    gh.GUI.Canvas.GH_Skin.canvas_mono_color = CanvasColour
else:
    gh.GUI.Canvas.GH_Skin.canvas_back = CanvasColour

# Other effects
gh.GUI.Canvas.GH_Skin.canvas_shade = Shade
gh.GUI.Canvas.GH_Skin.canvas_edge = CanvasEdge
gh.GUI.Canvas.GH_Skin.canvas_grid = Grid
# ---------- end canvas_colours ----------

tin = Mesh(<mesh referenced from the Rhino model>)
footprints = Mesh(<mesh referenced from the Rhino model>)
mesh_flip = MeshFlip(Mesh=footprints)
mesh_join = MeshJoin(Meshes=[mesh_flip, tin])
ghpython_script = GhPythonScript(TIN=mesh_join)  # -> out, path; inputs TIN: Mesh
# ---------- ghpython_script: Python ----------
import Rhino.Geometry as rg
import os
import json
from json import encoder
encoder.FLOAT_REPR = lambda x: format(x, '.3f') # globally format json floats

ghpath = ghenv.LocalScope.ghdoc.Path
ghdir = os.path.dirname(ghpath)
path = ghdir + "/../_data/export/tin_export.json"

def mesh_to_obj(mesh, index_offset):
    surface = [[[ v+index_offset for v in list(f)[0:3]]] if f.IsTriangle
               else [[ v+index_offset for v in list(f)]] for f in mesh.Faces]
    verts = [[float(v.X), float(v.Y), float(v.Z)] for v in mesh.Vertices]
    return surface, verts

tin_surface, tin_verts = mesh_to_obj(TIN, 0)

j = {
"type": "CityJSON",
"version": "1.0",
"metadata": {"referenceSystem": "urn:ogc:def:crs:EPSG::7415"},
"CityObjects": {},
"vertices": []
}

cityobj = {
    "type": "TINRelief",
    "geometry": [
        {
            "type": "CompositeSurface",
            "lod": 1,
            "boundaries" : tin_surface,
        }
    ]
}

j["CityObjects"]["TIN"] = cityobj
j["vertices"].extend(tin_verts)

with open(path, 'w') as outfile:
    json.dump(j, outfile)
# ---------- end ghpython_script ----------
panel = Panel(ghpython_script.path)
