# Grasshopper definition process_buildings_and_TIN.gh (Grasshopper 1.0.7)
# plug-ins: Geospatial, Ostate Plugin

# ----
# Canvas colours
boolean_toggle = BooleanToggle(False)
canvas_colours = PythonScript(
    Monochrome=boolean_toggle,
    CanvasColour=ColourSwatch(SwatchColor=RGB(255, 255, 255)),
    CanvasEdge=ColourSwatch(SwatchColor=RGB(0, 0, 0)),
    Shade=ColourSwatch(SwatchColor=RGBA(255, 255, 255, 0)),
    Grid=ColourSwatch(SwatchColor=RGBA(0, 0, 0, 0)))  # inputs Monochrome: Boolean, CanvasColour: Color, CanvasEdge: Color
# ---------- canvas_colours: Python ----------
import Grasshopper as gh

# Set background colour
gh.GUI.Canvas.GH_Skin.canvas_mono = Monochrome
if Monochrome:
    gh.GUI.Canvas.GH_Skin.canvas_mono_color = CanvasColour
else:
    gh.GUI.Canvas.GH_Skin.canvas_back = CanvasColour

# Other effects
gh.GUI.Canvas.GH_Skin.canvas_shade = Shade
gh.GUI.Canvas.GH_Skin.canvas_edge = CanvasEdge
gh.GUI.Canvas.GH_Skin.canvas_grid = Grid
# ---------- end canvas_colours ----------

file_path = FilePath("D:\DELFT\Q3 GEO1004 3D-Model\assignment3\_data\built_ht.geojson")
read_geojson = ReadGeoJSON(File=file_path)  # -> Type, Geometry, Keys, Values
boundary_surfaces = BoundarySurfaces(Edges=read_geojson.Geometry)
key_value_search = KeyValueSearch(Keys=read_geojson.Keys, Values=read_geojson.Values, Search="z_med_bott")
key_value_search_2 = KeyValueSearch(Keys=read_geojson.Keys, Values=read_geojson.Values, Search="identifica")
key_value_search_3 = KeyValueSearch(Keys=read_geojson.Keys, Values=read_geojson.Values, Search="diff_top_b")
key_value_search_4 = KeyValueSearch(Keys=read_geojson.Keys, Values=read_geojson.Values, Search="bouwjaar")

footprints = Data(flatten(boundary_surfaces))
year = Data(flatten(key_value_search_4))
base_z = Data(flatten(key_value_search))
height = Data(flatten(key_value_search_3))
id = Data(flatten(key_value_search_2))
ghpython_script = GhPythonScript(polygons=footprints, base_heights=base_z, heights=height, years=year, ids=id)  # -> out, export_path, base_meshes, roof_meshes, wall_meshes; inputs polygons: list of Brep, base_heights: list, heights: list, years: list, ids: list
# ---------- ghpython_script: Python ----------
import Rhino.Geometry as rg
import os
import json
from json import encoder
encoder.FLOAT_REPR = lambda x: format(x, '.2f') # globally format json floats

ghpath = ghenv.LocalScope.ghdoc.Path
ghdir = os.path.dirname(ghpath)
export_path = ghdir + "/../_data/export/buildings_export.json"

base_meshes = []
roof_meshes = []
wall_meshes = []

mesh_settings = rg.MeshingParameters.Coarse

def mesh_to_obj(mesh, index_offset):
    surface = [[[ v+index_offset for v in list(f)[0:3]]] if f.IsTriangle
               else [[ v+index_offset for v in list(f)]] for f in mesh.Faces]
    verts = [[float(v.X), float(v.Y), float(v.Z)] for v in mesh.Vertices]
    return surface, verts


for polygon, base_height, height, year, id in zip(
polygons, base_heights, heights, years, ids):
    
    # flip base surface if normal goes up
    if polygon.Surfaces[0].NormalAt(0,0).Z < 0:
        polygon.Flip()
    
    # move to base height
    trans = rg.Transform.Translation(0, 0, base_height)
    polygon.Transform(trans)
    
    # base mesh
    base_mesh = rg.Mesh.CreateFromBrep(polygon, mesh_settings)[0]
    base_meshes.append(base_mesh)
    
    # roof mesh
    trans = rg.Transform.Translation(0, 0, height)
    roof_mesh = base_mesh.Duplicate()
    roof_mesh.Flip(True, True, True)
    roof_mesh.Transform(trans)
    roof_meshes.append(roof_mesh)
    
    # wall mesh
    for i, ring in enumerate(polygon.Loops):
        curve = ring.To3dCurve()
        
        # check outter ring orientation
        if i == 0:
            if curve.ClosedCurveOrientation() == rg.CurveOrientation.Clockwise:
                curve.Reverse()
        # check inner ring orientation
        else:
            if curve.ClosedCurveOrientation() != rg.CurveOrientation.Clockwise:
                curve.Reverse()
        
        for segment in curve.DuplicateSegments():
            pass
# ---------- end ghpython_script ----------
ghpython_script_2 = GhPythonScript()  # -> out, path; inputs crowns: list of Mesh, trunks: list of Mesh; disabled
# ---------- ghpython_script_2: Python ----------
import Rhino.Geometry as rg
import os
import uuid
import json
from json import encoder
encoder.FLOAT_REPR = lambda o: format(o, '.1f') # globally format json floats

j = {
"type": "CityJSON",
"version": "1.0",
"CityObjects": {},
"vertices": []
}

def mesh_to_obj(mesh, index_offset):
    surface = [[[ v+index_offset for v in list(f)[0:3]]] if f.IsTriangle
               else [[ v+index_offset for v in list(f)]] for f in mesh.Faces]
    verts = [[float(v.X), float(v.Y), float(v.Z)] for v in mesh.Vertices]
    return surface, verts

vertex_count = 0

for crown, trunk in zip(crowns, trunks):
    id = str(uuid.uuid4())
    crown_surface, crown_verts = mesh_to_obj(crown, vertex_count)
    vertex_count += len(crown_verts)
    trunk_surface, trunk_verts = mesh_to_obj(trunk, vertex_count)
    vertex_count += len(trunk_verts)
    
    cityobj = {
        "type": "SolitaryVegetationObject",
        "geometry": [
            {
                "type": "Solid",
                "lod": 2,
                "boundaries" : [
                    crown_surface
                ]
            },
            {
            "type": "Solid",
                "lod": 2,
                "boundaries" : [
                    trunk_surface,
                ]
            }
        ]
    }
    
    j["CityObjects"][id] = cityobj
    j["vertices"].extend(crown_verts)
    j["vertices"].extend(trunk_verts)


ghpath = ghenv.LocalScope.ghdoc.Path
ghdir = os.path.dirname(ghpath)
path = ghdir + "/../_data/trees/trees_export.json"

with open(path, 'w') as outfile:
    json.dump(j, outfile)
# ---------- end ghpython_script_2 ----------
