# Grasshopper definition test_geojson_footprints.gh (Grasshopper 1.0.7)

# ----
# Canvas colours
boolean_toggle = BooleanToggle(False)
canvas_colours = PythonScript(
    Monochrome=boolean_toggle,
    CanvasColour=ColourSwatch(SwatchColor=RGB(255, 255, 255)),
    CanvasEdge=ColourSwatch(SwatchColor=RGB(0, 0, 0)),
    Shade=ColourSwatch(SwatchColor=RGBA(255, 255, 255, 0)),
    Grid=ColourSwatch(SwatchColor=RGBA(0, 0, 0, 0)))  # inputs Monochrome: Boolean, CanvasColour: Color, CanvasEdge: Color
# ---------- canvas_colours: Python ----------
import Grasshopper as gh

# Set background colour
gh.GUI.Canvas.GH_Skin.canvas_mono = Monochrome
if Monochrome:
    gh.GUI.Canvas.GH_Skin.canvas_mono_color = CanvasColour
else:
    gh.GUI.Canvas.GH_Skin.canvas_back = CanvasColour

# Other effects
gh.GUI.Canvas.GH_Skin.canvas_shade = Shade
gh.GUI.Canvas.GH_Skin.canvas_edge = CanvasEdge
gh.GUI.Canvas.GH_Skin.canvas_grid = Grid
# ---------- end canvas_colours ----------

file_path = FilePath("D:\DELFT\Q3 GEO1004 3D-Model\assignment3\_data\built_ht.geojson")
ghpython_script = GhPythonScript(path=file_path)  # -> out, points, inner_points
# ---------- ghpython_script: Python ----------
import Rhino.Geometry as rg
import json

j = {}

with open(path, 'r') as f:
    j = json.load(f)

for i, feature in enumerate(j['features']):
    geometry = feature['geometry']
    if geometry['type'] == "MultiPolygon":
        
        for p, polygon in enumerate(geometry['coordinates']):
            outter = polygon[0]
            holes = polygon[0:len(polygon)-1]
            
            points = []
            for coord in outter:
                points.append(rg.Point3d( coord[0], coord[1], 0 ))
            curve = rg.Polyline(points).ToNurbsCurve()
            
            if curve.ClosedCurveOrientation() == rg.CurveOrientation.Clockwise:
                print "Oh damn! #%s boundary is clockwise." % feature['properties']['identifica']
                j['features'][i]['geometry']['coordinates'][p][0] = list(reversed(outter))
            
#            for i, inner in enumerate(holes):
#                inner_points = []
#                for coord in inner:
#                    points.append(rg.Point3d( coord[0], coord[1], 0 ))
#                curve = rg.Polyline(points).ToNurbsCurve()
#                
#                if curve.ClosedCurveOrientation() == rg.CurveOrientation.CounterClockwise:
#                    print "Oh damn! #%s inner ring #%d is counter-clockwise." % (feature['properties']['identifica'], i)
#                    j['features'][i]['geometry']['coordinates'][p][1+i] = list(reversed(inner))

with open(path.replace('.','_fixed.'), 'w') as f:
    json.dump(j, f)
# ---------- end ghpython_script ----------
